# Grasshopper definition ISOVIST_2D.gh (Grasshopper 1.0.7)
# plug-ins: Human

list = ValueList({"Indoor": 0, "Outdoor": 1, "Indoor/Outdoor": 2}, selected="Outdoor")
brep = Brep([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])
crv = Curve(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)

# ---- group: GEOMETRY
brep_2 = Brep([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])
brep_3 = Brep([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])
crv_2 = Curve(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)
crv_3 = Curve(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)
filter = StreamFilter(Gate=list, Stream0=crv_3, Stream1=crv_2, Stream2=crv)
filter_2 = StreamFilter(Gate=list, Stream0=brep_2, Stream1=brep_3, Stream2=brep)

# ---- group: GEOMETRY / visualize
wires = BrepWireframe(Brep=filter_2, Density=-1)
previewlw = CustomPreviewLineweights(Geometry=wires, Shader=ColourSwatch(SwatchColor=RGB(0, 0, 0)), Thickness="2", Absolute=False)

# ---- group: GEOMETRY
previewlw_2 = CustomPreviewLineweights(Geometry=filter, Shader=ColourSwatch(SwatchColor=RGB(153, 153, 153)), Thickness="6", Absolute=False)

# ---- group: path
number_slider = Slider(2, range=0..150)
range = Range(Domain=Domain(0, 1), Steps="150")
item = ListItem(List=range, Index=number_slider, Wrap=True)
eval = EvaluateCurve(Curve=reparameterize(filter), Parameter=item)  # -> Point, Tangent, Angle

# ----
panel = Panel("62")
_2disovist = Ladybug_2DIsovist(
    context=filter_2,
    viewPoint=eval.Point,
    viewDirection=eval.Tangent,
    distanceLimits=Slider(73, range=10..200),
    viewAngle="25mph",
    runIt=Toggle(False))  # -> readMe, fixationDist, visibleAngle, viewRose; plug-in component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
lenp = LengthParameter(Curve=reparameterize(filter), Parameter=item)  # -> Length, Length_2
area = Area(Geometry=_2disovist.viewRose)  # -> Area, Centroid
panel_2 = Panel(_2disovist.visibleAngle)
panel_3 = Panel(area.Area)
preview = CustomPreview(Geometry=_2disovist.viewRose, Shader=ColourSwatch(SwatchColor=RGB(255, 162, 0)))

rec = DataRecorder(lenp.Length, DataLimit=-10, RecordData=False)
rec_2 = DataRecorder(panel_2, DataLimit=-10, RecordData=False)

graph = QuickGraph(rec_2, SortOrder=0)

sort = SortList(Keys=rec_2, ValuesA=rec)  # -> Keys, ValuesA
lng = ListLength(List=sort.Keys)  # -> expr("x-1", Length)
item_2 = ListItem(List=sort.ValuesA, Index=lng, Wrap=True)
item_3 = ListItem(List=sort.Keys, Index=lng, Wrap=True)
index = ItemIndex(List=rec, Item=item_2)
addition = Addition(A=index, B=1)
max_value = Panel(item_3)
path_length = Panel(item_2)
index_2 = Panel(addition)
item_4 = ListItem(List=range, Index=index_2, Wrap=True)
eval_2 = EvaluateCurve(Curve=reparameterize(filter), Parameter=item_4)  # -> Point, Tangent, Angle
dots = DotDisplay(Point=eval_2.Point, Colour=RGB(0, 0, 0), Size="0.5")
justified_text = JustifiedText3d(
    Location=eval_2.Point,
    Text=max_value,
    Size="0.8",
    Color=ColourSwatch(SwatchColor=RGB(0, 0, 0)),
    HorizontalAlignment="0",
    VerticalAlginment="0",
    UseMeshes=False,
    Bake=False)

fly = Ladybug_fly(inputSliders=number_slider, fly=Toggle(False))  # -> Vviiiiiiiiiizzz; plug-in component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
