# Grasshopper definition terrain_generator.gh (Grasshopper 1.0.7)
# plug-ins: Human

mapquest_api_key = Panel("YOUR MAPQUEST API KEY HERE!")
google_api_key = Panel("YOUR GOOGLE API KEY HERE!")
jawg_api_key = Panel("YOUR JAWG API KEY HERE!")
# requirements:
# - Ladybug legacy
# - Human
# 
# author: Antonello Di Nunzio
# 
# feel you free to improve python code!
# I wrote it years ago :)
ladybug = Ladybug_Ladybug()  # -> Vviiiiiiiiiizzz; plug-in component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
merge = Merge(Data1=google_api_key, Data2=mapquest_api_key, Data3=jawg_api_key)
number_slider = Slider(2, range=0..2)
item = ListItem(List=merge, Index=number_slider, Wrap=True)
# if you use jawg maps add the sleep factor to 1 sec
toggle = BooleanToggle(False)
terraingenerator = Ladybug_TerrainGenerator(
    source=number_slider,
    APIKEY=item,
    location="40.822381, 14.411396, 14",
    radius="300",
    type="0",
    runIt=toggle,
    texture=toggle,
    sleepFactor="1")  # -> readMe, tiles, pointsGeo, points, terrain, origin, elevation, port, imagePath; plug-in component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
panel = Panel(terraingenerator.readMe)
mesh = Mesh(terraingenerator.terrain)
previewmat = CustomPreviewMaterials(Geometry=terraingenerator.tiles, DiffuseColor=RGB(255, 255, 255), DiffuseBitmap=terraingenerator.imagePath)
